# Grasshopper definition FinalProject-CompFab.gh (Grasshopper 1.0.7)

pt = Point(<point referenced from the Rhino model>)
pt_2 = Point(<point referenced from the Rhino model>)
pt_3 = Point(<point referenced from the Rhino model>)
pt_4 = Point(<point referenced from the Rhino model>)
xz = XZPlane(Origin=pt)
xz_2 = XZPlane(Origin=pt_2)
xz_3 = XZPlane(Origin=pt_3)
pt_5 = Point(<point referenced from the Rhino model>)
xz_4 = XZPlane(Origin=pt_4)
pt_6 = Point(<point referenced from the Rhino model>)
rectangle = Rectangle(Plane=xz, XSize=Slider(5, range=0..10), YSize=Slider(3, range=0..10), Radius=Slider(0, range=0..100))  # -> Rectangle, Length
rectangle_2 = Rectangle(Plane=xz_3, XSize=Slider(7, range=0..10), YSize=Slider(5, range=0..10), Radius=Slider(0, range=0..100))  # -> Rectangle, Length
vec = VectorXYZ(XComponent=Slider(0, range=0..10), YComponent=0, ZComponent=Slider(1, range=0..10))  # -> Vector, Length
rectangle_3 = Rectangle(Plane=xz_2, XSize=Slider(5, range=0..10), YSize=Slider(3, range=0..10), Radius=Slider(0, range=0..100))  # -> Rectangle, Length
rectangle_4 = Rectangle(Plane=xz_4, XSize=Slider(7, range=0..10), YSize=Slider(5, range=0..10), Radius=Slider(0, range=0..100))  # -> Rectangle, Length
vec_2 = VectorXYZ(XComponent=Slider(0, range=0..10), YComponent=0, ZComponent=Slider(1, range=0..10))  # -> Vector, Length
rectangle_5 = Rectangle(Plane=pt_5, XSize=Slider(7, range=0..10), YSize=Slider(7, range=0..10), Radius=Slider(0, range=0..1))  # -> Rectangle, Length
rectangle_6 = Rectangle(Plane=pt_6, XSize=Slider(5, range=0..10), YSize=Slider(5, range=0..10), Radius=Slider(0, range=0..1))  # -> Rectangle, Length
boundary = BoundarySurfaces(Edges=rectangle_4.Rectangle)
move = Move(Geometry=rectangle.Rectangle, Motion=vec.Vector)  # -> Geometry, Transform
boundary_2 = BoundarySurfaces(Edges=rectangle_5.Rectangle)
boundary_3 = BoundarySurfaces(Edges=rectangle_6.Rectangle)
boundary_4 = BoundarySurfaces(Edges=rectangle_2.Rectangle)
move_2 = Move(Geometry=rectangle_3.Rectangle, Motion=vec_2.Vector)  # -> Geometry, Transform
boundary_5 = BoundarySurfaces(Edges=move.Geometry)
rdiff = RegionDifference(CurvesA=boundary_2, CurvesB=boundary_3)
boundary_6 = BoundarySurfaces(Edges=move_2.Geometry)
rdiff_2 = RegionDifference(CurvesA=boundary, CurvesB=boundary_5)
boundary_7 = BoundarySurfaces(Edges=rdiff)
rdiff_3 = RegionDifference(CurvesA=boundary_4, CurvesB=boundary_6)
boundary_8 = BoundarySurfaces(Edges=rdiff_2)
vec_3 = VectorXYZ(XComponent=0, YComponent=0, ZComponent=Slider(0.75, range=0..10))  # -> Vector, Length
vec_4 = VectorXYZ(XComponent=0, YComponent=Slider(0.75, range=0..10), ZComponent=0)  # -> Vector, Length
boundary_9 = BoundarySurfaces(Edges=rdiff_3)
extr = Extrude(Base=boundary_8, Direction=vec_4.Vector)
extr_2 = Extrude(Base=boundary_7, Direction=vec_3.Vector)
vec_5 = VectorXYZ(XComponent=0, YComponent=Slider(0.75, range=0..10), ZComponent=0)  # -> Vector, Length
cap = CapHoles(Brep=extr)
cap_2 = CapHoles(Brep=extr_2)
vec_6 = VectorXYZ(XComponent=Slider(-0.75, range=-5..1), YComponent=Slider(-0.5, range=-5..5), ZComponent=Slider(-2, range=-5..5))  # -> Vector, Length
extr_3 = Extrude(Base=boundary_9, Direction=vec_5.Vector)
rotate = Rotate(Geometry=cap, Angle=1.570796327, Plane=PlaneXY(0, 0, 0))  # -> Geometry, Transform
cap_3 = CapHoles(Brep=extr_3)
vec_7 = VectorXYZ(XComponent=Slider(8.5, range=-5..15), YComponent=Slider(-0.5, range=-5..5), ZComponent=Slider(-2, range=-5..5))  # -> Vector, Length
move_3 = Move(Geometry=cap_3, Motion=vec_6.Vector)  # -> Geometry, Transform
move_4 = Move(Geometry=rotate.Geometry, Motion=vec_7.Vector)  # -> Geometry, Transform
brep = Brep(cap_2)
srf = Surface(<surface referenced from the Rhino model>)
bbox = BoundingBox(Content=srf, Plane=PlaneXY(0, 0, 0))  # -> Box, Box_2
debox = DeconstructBox(Box=bbox.Box)  # -> Plane, X, Y, Z
boundary_10 = BoundarySurfaces(Edges=srf)
sdivide = DivideSurface(Surface=boundary_10, UCount=Slider(3, range=0..15), VCount=Slider(3, range=0..15))  # -> flatten(Points), Normals, Parameters
clean = CleanTree(RemoveNulls=True, RemoveInvalid=True, RemoveEmpty=False, Tree=sdivide.Points)
panel = Panel(clean)
python = GhPythonScript(flatPiece=brep, standingPiece=move_3.Geometry, standingRotated=move_4.Geometry, points=panel)  # -> a, b, c; inputs flatPiece: Brep, standingPiece: Brep, standingRotated: Brep, points: Vector3d
# ---------- python: Python ----------
__author__ = "smont"
__version__ = "2023.12.03"

import rhinoscriptsyntax as rs
import Rhino.Geometry as rg


flat = []
standing = []
standingRotate = []

points.X = int(points.X)
points.Y = int(points.Y)

moveTo = rg.Transform.Translation(0, 0, 2)
flatPiece.Transform(moveTo)
standingPiece.Transform(moveTo)
standingRotated.Transform(moveTo)

translationFlat = rg.Vector3d(points.X - 3, points.Y - 3, 0)
nextFlat = rs.CopyObject(flatPiece, translationFlat)
flat.append(nextFlat)
translationStanding = rg.Vector3d(points.X - 3, points.Y - 3, 0)
nextStanding = rs.CopyObject(standingPiece, translationStanding)
standing.append(nextStanding)
nextRotate = rs.CopyObject(standingRotated, translationFlat)
standingRotate.append(nextRotate)

a = flat
b = standing
c = standingRotate
# ---------- end python ----------
preview = CustomPreview(
    Geometry=python.c,
    Material={diffuse=RGB(221, 160, 221), emission=RGB(66, 48, 66), shine=0.5, specular=RGB(255, 255, 255), transparency=0})
preview_2 = CustomPreview(
    Geometry=python.a,
    Material={diffuse=RGB(221, 160, 221), emission=RGB(66, 48, 66), shine=0.5, specular=RGB(255, 255, 255), transparency=0})
preview_3 = CustomPreview(
    Geometry=python.b,
    Material={diffuse=RGB(221, 160, 221), emission=RGB(66, 48, 66), shine=0.5, specular=RGB(255, 255, 255), transparency=0})
