# Grasshopper definition M3_2.gh (Grasshopper 1.0.7)
# plug-ins: Weaverbird

number_slider = Slider(-20, range=-20..20)
number_slider_2 = Slider(20, range=-20..20)
number_slider_3 = Slider(14, range=-20..20)
number_slider_4 = Slider(10, range=-20..20)
pt = ConstructPoint(XCoordinate=0, YCoordinate=0, ZCoordinate=0)
dom = ConstructDomain(DomainStart=Slider(-8, range=-20..20), DomainEnd=number_slider_3)
dom_2 = ConstructDomain(DomainStart=number_slider, DomainEnd=number_slider_2)
dom_3 = ConstructDomain(DomainStart=Slider(0, range=-20..20), DomainEnd=number_slider_4)
dom_4 = ConstructDomain(DomainStart=number_slider, DomainEnd=number_slider_2)
dom_5 = ConstructDomain(DomainStart=Slider(7, range=-20..20), DomainEnd=number_slider_3)
dom_6 = ConstructDomain(DomainStart=number_slider_4, DomainEnd=Slider(26, range=5..100))
pt_2 = ConstructPoint(XCoordinate=0, YCoordinate=0, ZCoordinate=0)
box = DomainBox(Base=PlaneXY(0, 0, 0), X=dom_4, Y=dom_5, Z=dom_6)
line = LineSDL(Start=pt, Direction=Vector(0, 0, 1), Length=1)
box_2 = DomainBox(Base=PlaneXY(0, 0, 0), X=dom_2, Y=dom, Z=dom_3)
number_slider_5 = Slider(0, range=0..180)
line_2 = LineSDL(Start=pt_2, Direction=Vector(0, 0, 1), Length=number_slider_4)
twist = Twist(Geometry=box, Axis=line, Angle=degrees(number_slider_5), Infinite=False, Rigid=False)
twist_2 = Twist(Geometry=box_2, Axis=line_2, Angle=degrees(number_slider_5), Infinite=False, Rigid=False)
number_slider_6 = Slider(6, range=0..10)
number_slider_7 = Slider(2, range=0..10)
debrep = DeconstructBrep(Brep=twist)  # -> Faces, Edges, Vertices
debrep_2 = DeconstructBrep(Brep=twist_2)  # -> Faces, Edges, Vertices
mesh_uv = MeshSurface(Surface=debrep_2.Faces, UCount=number_slider_6, VCount=number_slider_7, Overhang=True, Equalize=False)
mesh_uv_2 = MeshSurface(Surface=debrep.Faces, UCount=number_slider_6, VCount=number_slider_7, Overhang=True, Equalize=False)
wbframe = WeaverbirdsPictureFrame(MeshPolylines=mesh_uv, Distance=5, InsetType=0)  # -> flatten(OutMesh)
wbframe_2 = WeaverbirdsPictureFrame(MeshPolylines=mesh_uv_2, Distance=5, InsetType=0)  # -> flatten(OutMesh)
number_slider_8 = Slider(1.9, range=0..10)
mjoin = MeshJoin(Meshes=wbframe)
mjoin_2 = MeshJoin(Meshes=wbframe_2)
wbthicken = WeaverbirdsMeshThicken(MeshCurves=mjoin, Distance=number_slider_8, OffsetType=0)
number_slider_9 = Slider(3, range=0..10)
wbthicken_2 = WeaverbirdsMeshThicken(MeshCurves=mjoin_2, Distance=number_slider_8, OffsetType=0)
wbcatmullclark = WeaverbirdsCatmullClarkSubdivision(MeshCurves=wbthicken, Level=number_slider_9, SmoothNakedEdges=1)
wbcatmullclark_2 = WeaverbirdsCatmullClarkSubdivision(MeshCurves=wbthicken_2, Level=number_slider_9, SmoothNakedEdges=1)
preview = CustomPreview(
    Geometry=wbcatmullclark,
    Material={diffuse=RGB(221, 160, 221), emission=RGB(66, 48, 66), shine=0.5, specular=RGB(255, 255, 255), transparency=0})
preview_2 = CustomPreview(
    Geometry=wbcatmullclark_2,
    Material={diffuse=RGB(221, 160, 221), emission=RGB(66, 48, 66), shine=0.5, specular=RGB(255, 255, 255), transparency=0})
